# Grasshopper definition CurveChordSplitterTest.gh (Grasshopper 1.0.7)
# plug-ins: Curve Split By Chords

panel = Panel("""4000
200
4000
200
4000
100""")
curve = Curve(<curve referenced from the Rhino model>)
curvechordsplitter = CurveChordSplitter(Curve=curve, Chords=panel)  # -> Points, Parameters
panel_2 = Panel(curvechordsplitter.Points)
panel_3 = Panel(curvechordsplitter.Parameters)
